# Dynamo graph 2.ExportMPolygonsToGeoJSON.dyn (Dynamo 2.5.2.7915)
# packages: Civil3DToolkit 1.1.24

current = Autodesk.AutoCAD.DynamoNodes.Document.Current()
modelSpace = Autodesk.AutoCAD.DynamoNodes.Document.ModelSpace(document=current)
getOdTables = Autodesk.Civil.DynamoNodes.GIS.ObjectData.OdTable.GetOdTables()
select_object = ObjectSelection()  # 1 picked in the model
getObjectOdRecords = Autodesk.Civil.DynamoNodes.GIS.ObjectData.OdTable.GetObjectOdRecords(odTable=getOdTables, obj=select_object)
getOdFields = Autodesk.Civil.DynamoNodes.GIS.ObjectData.OdTable.GetOdFields(odTable=getOdTables)
geometry = Autodesk.AutoCAD.DynamoNodes.Object.Geometry(object=select_object)
code_block = CodeBlock { a; Polyline.; }
