# Dynamo graph 3.GetAreafByStyles.dyn (Dynamo 2.5.2.7915)
# packages: Civil3DToolkit 1.1.24

current = Autodesk.AutoCAD.DynamoNodes.Document.Current()
getSites = Autodesk.Civil.DynamoNodes.LandDevelopment.Site.GetSites(document=current)

# group: В рамках каждой площадки в отдельности
gesAreaForParcelsByStyleAndSite = Python(IN[0]=getSites)
# ---------- gesAreaForParcelsByStyleAndSite.python (42 lines) ----------
import sys
import clr

# Add Assemblies for AutoCAD and Civil3D
clr.AddReference('AcMgd')
clr.AddReference('AcCoreMgd')
clr.AddReference('AcDbMgd')
clr.AddReference('AecBaseMgd')
clr.AddReference('AecPropDataMgd')
clr.AddReference('AeccDbMgd')

# Import references from AutoCAD
from Autodesk.AutoCAD.Runtime import *
from Autodesk.AutoCAD.ApplicationServices import *
from Autodesk.AutoCAD.EditorInput import *
from Autodesk.AutoCAD.DatabaseServices import *
from Autodesk.AutoCAD.Geometry import *



List_SitesDict = list()
a = float()

for OneSite in IN[0]:
	#Временный список для ремесловаря
	List_ForOutDict = list()
	#Временный список для наименования стилей участков
	List_ParcelsStyles = list()
	#Заполняем список наименований стилей участков
	for OneParcel in OneSite.GetParcels():
		if OneParcel.StyleName not in List_ParcelsStyles:
			List_ParcelsStyles.append(OneParcel.StyleName)
	#Заполняем значение атрибута площади для каждого из ключа
	for OneParcelStyle in List_ParcelsStyles:
		AreaOfParcels = float()
		for OneParcel in OneSite.GetParcels():
			if OneParcel.StyleName == OneParcelStyle:
				AreaOfParcels += OneParcel.Area
		List_ForOutDict.append([OneParcelStyle,AreaOfParcels])
	List_SitesDict.append([OneSite.Name,dict(List_ForOutDict)])

OUT = dict(List_SitesDict)
# ----------------------------------------

watch = Watch(gesAreaForParcelsByStyleAndSite)

# group: В рамках всех площадок
getParcels = Autodesk.Civil.DynamoNodes.LandDevelopment.Site.GetParcels(site=getSites)
gesAreaForParcelsByStyle = Python(IN[0]=getParcels)
# ---------- gesAreaForParcelsByStyle.python (40 lines) ----------
import sys
import clr

# Add Assemblies for AutoCAD and Civil3D
clr.AddReference('AcMgd')
clr.AddReference('AcCoreMgd')
clr.AddReference('AcDbMgd')
clr.AddReference('AecBaseMgd')
clr.AddReference('AecPropDataMgd')
clr.AddReference('AeccDbMgd')

# Import references from AutoCAD
from Autodesk.AutoCAD.Runtime import *
from Autodesk.AutoCAD.ApplicationServices import *
from Autodesk.AutoCAD.EditorInput import *
from Autodesk.AutoCAD.DatabaseServices import *
from Autodesk.AutoCAD.Geometry import *

ParcelList = list()
#Группируем участки в 1 список
for OneParcelsList in IN[0]:
	for OneParcel in OneParcelsList:
		ParcelList.append(OneParcel)
#Временный список для конечного словаря
List_ForOutDict = list()
#Временный список для наименования стилей участков
List_ParcelsStyles = list()
#Заполняем список наименований стилей участков
for OneParcel in ParcelList:
	if OneParcel.StyleName not in List_ParcelsStyles:
		List_ParcelsStyles.append(OneParcel.StyleName)
#Заполняем значение атрибута площади для каждого из ключа
for OneParcelStyle in List_ParcelsStyles:
	AreaOfParcels = float()
	for OneParcel in ParcelList:
		if OneParcel.StyleName == OneParcelStyle:
			AreaOfParcels += OneParcel.Area
	List_ForOutDict.append([OneParcelStyle,AreaOfParcels])
	
OUT = dict(List_ForOutDict)
# ----------------------------------------

watch_2 = Watch(gesAreaForParcelsByStyle)
