# Dynamo graph DataShortcuts_InsertObjByNameAndType.dyn (Dynamo 2.12.0.5650)

# group: Get info about DS folder path
dataShortcuts_GetInfoAboutFolders = Python()  # IronPython2
# ---------- dataShortcuts_GetInfoAboutFolders.python (32 lines) ----------
# Load the Python Standard and DesignScript Libraries
import sys
import clr

# Add Assemblies for AutoCAD and Civil3D
clr.AddReference('AcMgd')
clr.AddReference('AcCoreMgd')
clr.AddReference('AcDbMgd')
clr.AddReference('AecBaseMgd')
clr.AddReference('AecPropDataMgd')
clr.AddReference('AeccDbMgd')
clr.AddReference('AeccDataShortcutMgd')

# Import references from AutoCAD
from Autodesk.AutoCAD.ApplicationServices import *
from Autodesk.AutoCAD.DatabaseServices import *
from Autodesk.Civil.ApplicationServices import *
from Autodesk.Civil.DataShortcuts import *

ToExport = list()

adoc = Application.DocumentManager.MdiActiveDocument
editor = adoc.Editor

with adoc.LockDocument():
    with adoc.Database as db:
        with db.TransactionManager.StartTransaction() as t:
        	ToExport.append(DataShortcuts.GetWorkingFolder())
        	ToExport.append(DataShortcuts.GetCurrentProjectFolder())
		t.Commit()
# Assign your output to the OUT variable.
OUT = ToExport
# ----------------------------------------

# group: Get path to DS folder
code_block = CodeBlock(a=dataShortcuts_GetInfoAboutFolders) { a[0]; a[1]; "\\"; "\\_Shortcuts"; }
getfilepathtods_folder = String.Concat(string0=code_block.out0, string1=code_block.out2, string2=code_block.out1, string3=code_block.out3)

# group: Parse *.xml files to getting info about objects
getAllElementsFromDSFolder = Civil3D_CustomNodes.DataShortcuts.GetAllElementsFromDSFolder(PathToDSDir=getfilepathtods_folder)

# group: Initialize needing Types of Elements
alignment = Autodesk.Civil.DataShortcuts.DataShortcutEntityType.Alignment()
viewFrameGroup = Autodesk.Civil.DataShortcuts.DataShortcutEntityType.ViewFrameGroup()
needingElementsTypes = List.Create(item0=alignment, item1=viewFrameGroup)

# group: Grouping elements by needing filter (here -> name of elements)
whichElementsNeedSelect = StringInput("0918")  # graph input
getItemsList = Python(IN[0]=getAllElementsFromDSFolder.DataShortcutEntityType, IN[1]=getAllElementsFromDSFolder.ParentDrawingPath, IN[2]=getAllElementsFromDSFolder.ObjName, IN[3]=getAllElementsFromDSFolder.HandleLow, IN[4]=whichElementsNeedSelect, IN[5]=needingElementsTypes)  # IronPython2
# ---------- getItemsList.python (40 lines) ----------
# Load the Python Standard and DesignScript Libraries
import sys
import clr

# Add Assemblies for AutoCAD and Civil3D
clr.AddReference('AcMgd')
clr.AddReference('AcCoreMgd')
clr.AddReference('AcDbMgd')
clr.AddReference('AecBaseMgd')
clr.AddReference('AecPropDataMgd')
clr.AddReference('AeccDbMgd')
clr.AddReference('AeccDataShortcutMgd')

# Import references from AutoCAD
from Autodesk.AutoCAD.Runtime import *
from Autodesk.AutoCAD.ApplicationServices import *
from Autodesk.AutoCAD.EditorInput import *
from Autodesk.AutoCAD.DatabaseServices import *
from Autodesk.AutoCAD.Geometry import *
from Autodesk.Civil.DataShortcuts import *

# Import references from Civil3D
from Autodesk.Civil.ApplicationServices import *
from Autodesk.Civil.DatabaseServices import *

# The inputs to this node will be stored as a list in the IN variables.
DataTypes = IN[0]
PathsToParentFile = IN[1]
ObjNames = IN[2]
ObjHandles = IN[3]
NeedingName = IN[4]
NeedindTypeList = IN[5]
LenOfLists = len(DataTypes)

ListWithItems = list()
for OneIndex in range(0,LenOfLists):
	if NeedingName in ObjNames[OneIndex] and (DataTypes[OneIndex] in NeedindTypeList):
		ListWithItems.append([ObjNames[OneIndex],PathsToParentFile[OneIndex],DataTypes[OneIndex],ObjHandles[OneIndex]])
# Assign your output to the OUT variable.
OUT = ListWithItems
# ----------------------------------------

insertItemsToDrawing = Python(IN[0]=getItemsList)  # IronPython2; graph output
# ---------- insertItemsToDrawing.python (32 lines) ----------
# Load the Python Standard and DesignScript Libraries
import sys
import clr

# Add Assemblies for AutoCAD and Civil3D
clr.AddReference('AcMgd')
clr.AddReference('AcCoreMgd')
clr.AddReference('AcDbMgd')
clr.AddReference('AecBaseMgd')
clr.AddReference('AecPropDataMgd')
clr.AddReference('AeccDbMgd')
clr.AddReference('AeccDataShortcutMgd')

# Import references from AutoCAD
from Autodesk.AutoCAD.ApplicationServices import *
from Autodesk.AutoCAD.DatabaseServices import *
from Autodesk.Civil.ApplicationServices import *
from Autodesk.Civil.DataShortcuts import *

ToExport = list()

adoc = Application.DocumentManager.MdiActiveDocument
editor = adoc.Editor

with adoc.LockDocument():
    with adoc.Database as db:
        with db.TransactionManager.StartTransaction() as t:
        	for OneItem in IN[0]:
        		DataShortcuts.CreateReference(db,OneItem[1],OneItem[0],OneItem[2])
		t.Commit()
# Assign your output to the OUT variable.
OUT = 0
# ----------------------------------------
