# Dynamo graph SolidPS_1.dyn (Dynamo 2.5.2.7915)
# packages: Civil3DToolkit 1.1.28

current = Autodesk.AutoCAD.DynamoNodes.Document.Current()  # frozen

# group: Получение набора характеристик с полями
nameOfPS_Surfaces = StringInput("Поверхности")  # graph input
propertySetDefinitionByName = Autodesk.AutoCAD.DynamoNodes.Document.PropertySetDefinitionByName(document=current, name=nameOfPS_Surfaces)
propertyDefinitions = Autodesk.AutoCAD.DynamoNodes.PropertySetDefinition.PropertyDefinitions(propertySetDefinition=propertySetDefinitionByName)

# group: Присвоение их поверхностям
surfaces = Surfaces(document=current)
name = Autodesk.AutoCAD.DynamoNodes.PropertySetDefinition.Name(propertySetDefinition=propertySetDefinitionByName)
addPropertySet = Autodesk.AutoCAD.DynamoNodes.Object.AddPropertySet(object=surfaces, propertySetDefinitionName=name)

# group: Свои атрибуты
имяПоверхности = CodeBlock(a=surfaces) { a.Name; }
some_logical = Python(IN[0]=имяПоверхности)  # unwired: IN[1], IN[2]
# ---------- some_logical.python (43 lines) ----------
# Load the Python Standard and DesignScript Libraries
import sys
import clr

# Add Assemblies for AutoCAD and Civil3D
clr.AddReference('AcMgd')
clr.AddReference('AcCoreMgd')
clr.AddReference('AcDbMgd')
clr.AddReference('AecBaseMgd')
clr.AddReference('AecPropDataMgd')
clr.AddReference('AeccDbMgd')

# Import references from AutoCAD
from Autodesk.AutoCAD.Runtime import *
from Autodesk.AutoCAD.ApplicationServices import *
from Autodesk.AutoCAD.EditorInput import *
from Autodesk.AutoCAD.DatabaseServices import *
from Autodesk.AutoCAD.Geometry import *

# Import references from Civil3D
from Autodesk.Civil.ApplicationServices import *
from Autodesk.Civil.DatabaseServices import *

# The inputs to this node will be stored as a list in the IN variables.
dataEnteringNode = IN

adoc = Application.DocumentManager.MdiActiveDocument
editor = adoc.Editor

with adoc.LockDocument():
    with adoc.Database as db:

        with db.TransactionManager.StartTransaction() as t:
            # Place your code below
            # 
            #

            # Commit before end transaction
            #t.Commit()
            pass

# Assign your output to the OUT variable.
OUT = 0
# ----------------------------------------
code_block = CodeBlock(a=some_logical) { a[0]; a[1]; }

setPropertyValueByName = Autodesk.AutoCAD.DynamoNodes.PropertySetsExtensions.SetPropertyValueByName(obj=addPropertySet, propertySetName=name, propertyName=code_block.out0, propertyValue=code_block.out1)  # frozen
