# Dynamo graph SolidPS_2.dyn (Dynamo 2.12.0.5650)
# packages: Civil3DToolkit 1.1.30, Civil3D.CustomNodes 1.0.11

# note: Назначение идентификатора телу

# group: Выборка поверхностей (между чем формировать тела)
current = Autodesk.AutoCAD.DynamoNodes.Document.Current()
surfaces = Surfaces(document=current)
surface_s_names = CodeBlock(a=surfaces) { a.Name; }
surface_top__list = CodeBlock()
# ---------- surface_top__list.designscript (2 lines) ----------
["1","2","1",
"1","2","3"];
# ----------------------------------------
surface_base__list = CodeBlock()
# ---------- surface_base__list.designscript (2 lines) ----------
["2","3","3",
"N17","N17","N17"];
# ----------------------------------------

# group: Вспомогательная таблица ObjectData (для идентификации солидов)
code_block = CodeBlock { "Solids_Preview"; "Auxiliary names for 3D-solids"; true; }
code_block_2 = CodeBlock { "Top_Bottom-Surface"; "Identify surfaces"; }

odfield_data_types = OdDataTypeDropDown("Character")
create = Autodesk.Civil.DynamoNodes.GIS.ObjectData.OdField.Create(name=code_block_2.out0, dataType=odfield_data_types, description=code_block_2.out1)
addTable = Autodesk.Civil.DynamoNodes.GIS.ObjectData.OdTable.AddTable(name=code_block.out0, fields=create, description=code_block.out1, isXDataRecords=code_block.out2)

# group: Параметры для запуска процесса формирования тел
current_2 = Autodesk.AutoCAD.DynamoNodes.Document.Current()
путь_к_папке_с_логом = StringInput("E:\\Temp")  # graph input
слой = StringInput("0")  # graph input
разделитель_имен_поверхностей = StringInput("___")  # graph input
bySurfaces = Autodesk.Civil3D_CustomNodes.Solids.BySurfaces(doc_dyn=current_2, TopSurfacesNames=surface_top__list, BottomSurfacesNames=surface_base__list, PathToFolderSaveLog=путь_к_папке_с_логом, layer=слой, Id_separator=разделитель_имен_поверхностей)

# group: Получение объектов
current_3 = Autodesk.AutoCAD.DynamoNodes.Document.Current()
modeForWrite = Autodesk.Civil3D_CustomNodes.Selection.ModeForWrite()
getAcadObjectsByObjectsId = Autodesk.Civil3D_CustomNodes.Selection.GetAcadObjectsByObjectsId(doc_dyn=current_3, objects_id=bySurfaces.Solid_s_instances, mode=modeForWrite)

# group: Присвоение объектам характеристик
create_2 = Autodesk.Civil.DynamoNodes.GIS.ObjectData.OdRecord.Create(table=addTable, obj=getAcadObjectsByObjectsId)
setValueByName = Autodesk.Civil.DynamoNodes.GIS.ObjectData.OdRecord.SetValueByName(odRecord=create_2, name=code_block_2.out0, value=bySurfaces.Solid_s_ids_by_surfaces)
