# Dynamo graph SolidPS_3.dyn (Dynamo 2.12.0.5650)
# packages: Civil3D.CustomNodes 1.0.11, Civil3DToolkit 1.1.30

# group: Получение набора характеристик с полями для тел
current = Autodesk.AutoCAD.DynamoNodes.Document.Current()
nameOfPS_Solids = StringInput("Поверхности")  # graph input
propertySetDefinitionByName = Autodesk.AutoCAD.DynamoNodes.Document.PropertySetDefinitionByName(document=current, name=nameOfPS_Solids)
propertyDefinitions = Autodesk.AutoCAD.DynamoNodes.PropertySetDefinition.PropertyDefinitions(propertySetDefinition=propertySetDefinitionByName)

# group: Выборка солидов
current_2 = Autodesk.AutoCAD.DynamoNodes.Document.Current()
getDxfCodesToTypedValues = Autodesk.Civil3D_CustomNodes.Selection.GetDxfCodesToTypedValues()
string_from_object = FromObject(object=getDxfCodesToTypedValues.DxfCode_LayerName)
string_from_object_2 = FromObject(object=getDxfCodesToTypedValues.DxfCode_Start)
критерии_выборки = List.Create(item0=string_from_object, item1=string_from_object_2)
значения = CodeBlock { "0"; "3DSOLID"; }
значения_критериев = List.Create(item0=значения.out0, item1=значения.out1)
byKeysValues = DesignScript.Builtin.Dictionary.ByKeysValues(keys=критерии_выборки, values=значения_критериев)
selectObjectsByConditions = Autodesk.Civil3D_CustomNodes.Selection.SelectObjectsByConditions(SearchConditions=byKeysValues)
modeForWrite = Autodesk.Civil3D_CustomNodes.Selection.ModeForWrite()
getAcadObjectsByObjectsId = Autodesk.Civil3D_CustomNodes.Selection.GetAcadObjectsByObjectsId(doc_dyn=current_2, objects_id=selectObjectsByConditions, mode=modeForWrite)

# group: Получение идентификатора солида
getOdTables = Autodesk.Civil.DynamoNodes.GIS.ObjectData.OdTable.GetOdTables()
параметры = CodeBlock { "Solids_Preview"; "Top_Bottom-Surface"; "___"; }
getOdByName = Python(IN[0]=getOdTables, IN[1]=параметры.out0)  # IronPython2
# ---------- getOdByName.python (12 lines) ----------
# Load the Python Standard and DesignScript Libraries
import sys
import clr

T = IN[0]
NeedingName = IN[1]
T_need = T[0]
for t in T:
	if t.Name ==NeedingName:
		T_need = t
		break
OUT = T_need
# ----------------------------------------
getObjectOdRecords = Autodesk.Civil.DynamoNodes.GIS.ObjectData.OdTable.GetObjectOdRecords(odTable=getOdByName, obj=getAcadObjectsByObjectsId)
getValueByName = Autodesk.Civil.DynamoNodes.GIS.ObjectData.OdRecord.GetValueByName(odRecord=getObjectOdRecords, name=параметры.out1)
flatten = List.Flatten(list=getValueByName)

# group: Получение поверхностей по идентификатору
split = String.Split(string=flatten, separator0=параметры.out2)
get_names = Python(IN[0]=split)  # IronPython2
# ---------- get_names.python (11 lines) ----------
# Load the Python Standard and DesignScript Libraries
import sys
import clr

surfaces_list = IN[0]
top_list = list()
bottom_list = list()
for one_list in surfaces_list:
	top_list.append(one_list[0])
	bottom_list.append(one_list[1])
OUT = top_list,bottom_list
# ----------------------------------------
code_block = CodeBlock(a=get_names) { a[0]; a[1]; }
current_3 = Autodesk.AutoCAD.DynamoNodes.Document.Current()
selection_surfacebyname_top = Autodesk.Civil.DynamoNodes.Selection.SurfaceByName(name=code_block.out0, document=current_3)
selection_surfacebyname_bottom = Autodesk.Civil.DynamoNodes.Selection.SurfaceByName(name=code_block.out1, document=current_3)

# group: Для первой поверхности
propertySets = Autodesk.AutoCAD.DynamoNodes.Object.PropertySets(object=selection_surfacebyname_top)
flatten_2 = List.Flatten(list=propertySets)
properties = Autodesk.AutoCAD.DynamoNodes.PropertySet.Properties(propertySet=flatten_2)
name = Autodesk.AutoCAD.DynamoNodes.Property.Name(property=properties)
value = Autodesk.AutoCAD.DynamoNodes.Property.Value(property=properties)

# group: Для второй поверхности
propertySets_2 = Autodesk.AutoCAD.DynamoNodes.Object.PropertySets(object=selection_surfacebyname_bottom)
flatten_3 = List.Flatten(list=propertySets_2)
properties_2 = Autodesk.AutoCAD.DynamoNodes.PropertySet.Properties(propertySet=flatten_3)
name_2 = Autodesk.AutoCAD.DynamoNodes.Property.Name(property=properties_2)
value_2 = Autodesk.AutoCAD.DynamoNodes.Property.Value(property=properties_2)

# group: Получение набора характеристик с полями для тел
current_4 = Autodesk.AutoCAD.DynamoNodes.Document.Current()
nameOfPS_Solids_2 = StringInput("Тела")  # graph input
propertySetDefinitionByName_2 = Autodesk.AutoCAD.DynamoNodes.Document.PropertySetDefinitionByName(document=current_4, name=nameOfPS_Solids_2)
propertyDefinitions_2 = Autodesk.AutoCAD.DynamoNodes.PropertySetDefinition.PropertyDefinitions(propertySetDefinition=propertySetDefinitionByName_2)
prop_set_name = CodeBlock(a=propertyDefinitions_2) { a.Name; }
code_block_2 = CodeBlock(a=prop_set_name) { a[4]; a[5]; }
name_3 = Autodesk.AutoCAD.DynamoNodes.PropertySetDefinition.Name(propertySetDefinition=propertySetDefinitionByName_2)

# group: Синхронизация свойств и назначение их телу
organize_data = Python(IN[0]=value, IN[1]=value_2, IN[2]=getAcadObjectsByObjectsId, IN[3]=code_block_2.out0, IN[4]=code_block_2.out1)  # IronPython2
# ---------- organize_data.python (20 lines) ----------
# Load the Python Standard and DesignScript Libraries
import sys
import clr

#Input data
TopSurf_data = IN[0]
BottomSurf_data = IN[1]
Objects_list = IN[2]
top_name = IN[3]
bottom_name = IN[4]
#Output data
prop_names = list()
prop_values = list()

for i in range(0, len(Objects_list),1):
	solid_surf_top = str(TopSurf_data[i][1])
	solid_surf_bottom = str(BottomSurf_data[i][1])
	prop_names.append([top_name,bottom_name])
	prop_values.append([solid_surf_top,solid_surf_bottom])
OUT = Objects_list,prop_names,prop_values
# ----------------------------------------
code_block_3 = CodeBlock(a=organize_data) { a[0]; a[1]; a[2]; }
addPropertySet = Autodesk.AutoCAD.DynamoNodes.Object.AddPropertySet(object=code_block_3.out0, propertySetDefinitionName=name_3)
setPropertyValueByName = Autodesk.AutoCAD.DynamoNodes.PropertySetsExtensions.SetPropertyValueByName(obj=addPropertySet, propertySetName=nameOfPS_Solids_2, propertyName=code_block_3.out1, propertyValue=code_block_3.out2)
